# Grasshopper definition Fixed Layer Width Script 00.gh (Grasshopper 1.0.7)
# plug-ins: Pufferfish, Kangaroo2 Components

# ---- group: INPUT
# Notes: --fixed thread mesh prepper --
# 
# This script turns polysurface files (imported okay) into solid relative thickness meshes which can then be sliced into consistent single or more line prints. this scirpt is a workaround for slicers that lack this inate cabaility like orca or slic3r. Cura allows for single wall mesh printing when in 'Surface Mode'.
# 
# The script does this through the following steps:
# 1).convert polysurface to mesh
# 2). thicken mesh
# 3). point move offset surfaces to achieve uniform thickness at local elevation xy plane.
# 
# For best results consider the following:
# 1). use fillets in your polysurface. sharp corners confuse the thickening operation in some instances. sharp corners are also more likely to create a break in the slicer result.
# 
# This script is very much a workaround. The better way to make a single line print would be to program the toolpath itself. but, that would also involve sending custom gcode, which always carries the risk of damaging an otherwise functional printer. consider this script for the not so brave of heart.
# 
# --the future of printing, Jasper--
layer_width = Panel("1.2")
brep = Brep(<brep referenced from the Rhino model>)
preview = CustomPreview(
    Geometry=brep,
    Material={diffuse=RGB(221, 160, 221), emission=RGB(66, 48, 66), shine=0.5, specular=RGB(255, 255, 255), transparency=0})

# ---- group: Mesh settings
# Feel free to modify these meshing settings. In general lower resolution meshes has worse offsetting results than high resution meshes. Again, filleting edges increases the change of a water tight thickened mesh.
panel = Panel("1")
custom_mesh_settings = SettingsCustom(
    StitchSeams=True,
    SimplePlanes=False,
    Refine=True,
    MinCount=16,
    MaxCount=400,
    AspectRatio=20,
    MaxDistance=0,
    MaxAngle=panel,
    MinEdge=0,
    MaxEdge=0)

# ----
division = Division(A=layer_width, B="2")

# ---- group: Mesh Preperation
mesh = MeshBrep(Brep=brep, Settings=custom_mesh_settings)
qrmesh = QuadRemesh(Mesh=mesh, Settings={aqc=True, as=50, dhe=True, gci=0, null=False, pme=0, sa=0, tqc=2000})
toggle = BooleanToggle(True)
offmsh = OffsetMesh(Mesh=qrmesh, Distance=division, BothSides=toggle, CreateSolid=toggle)
demesh = DeconstructMesh(Mesh=qrmesh)  # -> Vertices, Faces, Colours, Normals
demesh_2 = DeconstructMesh(Mesh=offmsh)  # -> Vertices, Faces, Colours, Normals
lng = ListLength(List=demesh.Vertices)
duppt = RemoveDuplicatePts(Points=demesh_2.Vertices, Tolerance=0.01)
split = SplitList(List=duppt, Index=lng)  # -> ListA, ListB

# ----
panel_2 = Panel(division)

# ---- group: Mesh Side 1 Manipulation
preview_2 = CustomPreview(
    Geometry=split.ListA,
    Material={diffuse=RGB(221, 160, 221), emission=RGB(66, 48, 66), shine=0.5, specular=RGB(255, 255, 255), transparency=0})
neg = Negative(Value=demesh.Normals)
devec = DeconstructVector(Vector=neg)  # -> XComponent, YComponent, ZComponent
amp = Amplitude(Vector=neg, Amplitude=division)
vec = VectorXYZ(XComponent=devec.XComponent, YComponent=devec.YComponent, ZComponent="0")  # -> Vector, Length
amp_2 = Amplitude(Vector=vec.Vector, Amplitude=division)
subtraction = Subtraction(A=amp_2, B=amp)
pdeform = PointDeform(Geometry=offmsh, Points=split.ListA, Motion=subtraction)

# ---- group: Mesh Side 2 Manipulation
preview_3 = CustomPreview(
    Geometry=split.ListB,
    Material={diffuse=RGB(221, 160, 221), emission=RGB(66, 48, 66), shine=0.5, specular=RGB(255, 255, 255), transparency=0})
amp_3 = Amplitude(Vector=demesh.Normals, Amplitude=division)
devec_2 = DeconstructVector(Vector=demesh.Normals)  # -> XComponent, YComponent, ZComponent
vec_2 = VectorXYZ(XComponent=devec_2.XComponent, YComponent=devec_2.YComponent, ZComponent="0")  # -> Vector, Length
amp_4 = Amplitude(Vector=vec_2.Vector, Amplitude=division)
subtraction_2 = Subtraction(A=amp_4, B=amp_3)

# ---- group: Output Mesh
# Bake this mesh, than export it into you slicer program of choice.
pdeform_2 = PointDeform(Geometry=pdeform, Points=split.ListB, Motion=subtraction_2)  # -> flatten(Geometry)
panel_3 = Panel(pdeform_2)
